# Grasshopper definition spg2.gh (Grasshopper 0.9.80)
# plug-ins: dotsdev

path = FilePath("/Users/nirviksaha/Projects/inputs_for_dots/adj_inputs.csv")
path_2 = FilePath("/Users/nirviksaha/Projects/inputs_for_dots/geom_inputs.csv")
inputs = Dots_dev(FilePathAdjacency=path, FilePathGeometry=path_2)  # -> OutputAdjacency, OutputFunctions, DisplayLines, DisplayPolyline, PolyPoints
Z = UnitZ(Factor=1)
move = Move(Geometry=inputs.DisplayLines, Motion=Z)  # -> Geometry, Transform
panel = Panel(inputs.OutputFunctions)
